# Grasshopper definition 15_making a gable roof.gh (Grasshopper 1.0.7)
# plug-ins: ScriptParasite

toggle = BooleanToggle(True)
number_slider = Slider(0.48, range=0..1)
crv = Curve([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])
explode = Explode(Curve=crv, Recursive=True)  # -> Segments, Vertices
disc = Discontinuity(Curve=crv, Level=1)  # -> Points, Parameters
pi = Pi(Factor=Slider(0.2, range=0..2))
rider = RIder(openFile=toggle)  # -> Folder; inputs openFile: Boolean
# ---------- rider: C# usings ----------
using System.IO;
using System.Diagnostics;

public class ScriptUtilities
{
  public static string GetCurrentFolder(GH_Document doc)
  {
    string filePath = doc.FilePath;
    return Path.GetDirectoryName(filePath);
  }

  public static string[] GetCsFiles(string folderPath)
  {
    return Directory.GetFiles(folderPath, "*.cs");
  }

  public static void OpenFileWithRider(string filePath, Action<string> print)
  {
    try
    {
      // Define the path to the JetBrains Rider executable
      string riderPath = @"C:\Program Files\JetBrains\JetBrains Rider 2024.1.4\bin\rider64.exe";

      if (!File.Exists(riderPath))
      {
        print("Rider executable not found at: " + riderPath);
        return;
      }

      // Start the process to open the file with Rider
      ProcessStartInfo startInfo = new ProcessStartInfo
        {
          FileName = riderPath,
          Arguments = "\"" + filePath + "\"", // Enclose in quotes in case of spaces
          UseShellExecute = true
          };
      Process.Start(startInfo);
    }
    catch (Exception ex)
    {
      print("Error opening file with Rider: " + ex.Message);
    }
  }

  public static void RunScript(bool openFile, ref object Here, IGH_Component owner, Action<string> print)
  {
    // Get the current folder path
    GH_Document doc = owner.OnPingDocument();
    string currentFolder = GetCurrentFolder(doc);
    Here = currentFolder;

    // Get .cs files in the current folder
    string[] csFiles = GetCsFiles(currentFolder);
    if (csFiles.Length > 0)
    {
      string csFilePath = csFiles[0];

      if (openFile)
      {
        OpenFileWithRider(csFilePath, print);
      }
    }
    else
    {
      print("No .cs files found in the directory.");
    }
  }
}
# ---------- rider: C# ----------
   ScriptUtilities.RunScript(openFile, ref Folder, Component, Print);
# ---------- end rider ----------
crv_2 = Curve([<curve referenced from the Rhino model> x8])
pline = PolyLine(Vertices=disc.Points, Closed=invert(False))
kinkcrv = KinkyCurve(Vertices=explode.Vertices, Degree=Slider(3, range=0..10), Angle=pi)  # -> Curve, Length, Domain

scriptpar = ScriptParasite(Enable=toggle, Folder=rider)
c_script = CSharpScript(x=crv_2, y=Slider(0, range=0..10))  # -> out, A, B; inputs x: list of Curve, y: Int32
# ---------- c_script: C# usings ----------
using System.Data;
using System.Linq;
# ---------- c_script: C# ----------
    List<List<Point3d>> pdPts = new List<List<Point3d>>();
    List<Point3d> stPts = new List<Point3d>();
    for(int i = 0; i < x.Count; i++)
    {
      var tmp = PureDiscontinuity(x[i]); 
      pdPts.Add(PureDiscontinuity(x[i])); 
    }

    A = MakeDataTree2D(pdPts);
# ---------- c_script: C# additional code ----------
  public static DataTree<T> MakeDataTree2D<T>(List<List<T>> ret)
  {
    DataTree<T> tree = new DataTree<T>();
    for (int i = 0; i < ret.Count; i++)
    {
      GH_Path path = new GH_Path(i);
      for (int j = 0; j < ret[i].Count; j++)
      {

        tree.Add(ret[i][j], path);
      }
    }

    return tree;
  }
  public List<Point3d> PureDiscontinuity(Curve x)
  {
    var seg = x.DuplicateSegments();
    List<Point3d> pts = new List<Point3d>();
    for (int i = 0; i < seg.Length - 1; i++)
    {
      var nowC = seg[i];
      var nxtC = seg[i + 1];
      var nowV = nowC.PointAtEnd - nowC.PointAtStart;
      var nxtV = nxtC.PointAtEnd - nxtC.PointAtStart;
      nowV.Unitize();
      nxtV.Unitize();
      double dp = Math.Abs(nowV * nxtV);
      if (i == 0)
      {
        var prevC = seg[seg.Length - 1];
        var prevV = prevC.PointAtEnd - prevC.PointAtStart;
        prevV.Unitize(); 
        if(Math.Abs(prevV * nowV) < 0.99) pts.Add(nowC.PointAtStart);
      }
      if (dp < 0.99)
      {
        pts.Add(nowC.PointAtEnd);
      }

      Print(dp.ToString()); 
    }
    if (!x.IsClosed) pts.Add(seg[seg.Length - 1].PointAtEnd);
    return pts;
  }
# ---------- end c_script ----------

disc_2 = Discontinuity(Curve=kinkcrv.Curve, Level=1)  # -> Points, Parameters
panel = Panel(c_script.out)
item = ListItem(List=c_script.A, Index=Slider(4, range=0..100), Wrap=True)
pline_2 = PolyLine(Vertices=disc_2.Points, Closed=invert(False))
neg = Negative(Value=Slider(4.1, range=0..100))
pt = Point(c_script.B)
offset = OffsetCurve(Curve=pline_2, Distance=neg, Corners=1)
explode_2 = Explode(Curve=offset, Recursive=True)  # -> Segments, Vertices
boundary = BoundarySurfaces(Edges=pline_2)  # -> simplify(Surfaces)
explode_3 = Explode(Curve=pline_2, Recursive=True)  # -> Segments, Vertices
len = Length(Curve=explode_2.Segments)
sort = SortList(Keys=len, ValuesA=explode_3.Segments)  # -> Keys, ValuesA
panel_2 = Panel("""0
1""")
cull_i = CullIndex(List=sort.ValuesA, Indices=panel_2, Wrap=True)
join = JoinCurves(Curves=cull_i, Preserve=False)
item_2 = ListItem(List=join, Index=0, Wrap=True)
Z = UnitZ(Factor=Slider(3, range=0..10))
flip = FlipCurve(Curve=join, Guide=item_2)  # -> simplify(Curve), Flag
disc_3 = Discontinuity(Curve=flip.Curve, Level=1)  # -> Points, Parameters
crv_3 = Curve([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])
path_mapper = PathMapper(disc_3.Points, source="{A;B}(i)", target="{A;i}")
item_3 = ListItem(List=flip.Curve, Index=0, Wrap=True)  # -> Item, Item1
disc_4 = Discontinuity(Curve=crv_3, Level=1)  # -> Points, Parameters
move = Move(Geometry=flip.Curve, Motion=Z)  # -> Geometry, Transform
extr = Extrude(Base=flip.Curve, Direction=Z)
explode_4 = Explode(Curve=item_3.Item, Recursive=True)  # -> graft(Segments), Vertices
explode_5 = Explode(Curve=item_3.Item1, Recursive=True)  # -> graft(Segments), Vertices
viewer = ParamViewer(disc_4.Points)
flip_2 = FlipMatrix(Data=disc_4.Points)
item_4 = ListItem(List=move.Geometry, Index=0, Wrap=True)  # -> Item, Item1
avr = Average(Input=path_mapper)
pline_3 = PolyLine(Vertices=path_mapper, Closed=False)
number_slider_2 = Slider(3, range=0..10)
merge = Merge(Data1=explode_4.Segments, Data2=explode_5.Segments)
viewer_2 = ParamViewer(flip_2)
midpt = CurveMiddle(Curve=pline_3)
pshift = ShiftPaths(Data=avr, Offset=-1)
item_5 = ListItem(List=merge, Index=0, Wrap=True)  # -> Item, Item1
pshift_2 = ShiftPaths(Data=midpt, Offset=-1)
pline_4 = PolyLine(Vertices=pshift, Closed=False)
tweencrv = TweenCurve(CurveA=item_5.Item, CurveB=item_5.Item1, Factor=Slider(0.5, range=0..1), BlendType=0)
merge_2 = Merge(Data1=number_slider_2, Data2=Slider(6, range=0..10), Data3=number_slider_2)
weave = Weave(Pattern=[0, 1], Stream0=flip.Curve, Stream1=pline_4, NullGaps=False)
pline_5 = PolyLine(Vertices=pshift_2, Closed=False)
pshift_3 = ShiftPaths(Data=tweencrv, Offset=-1)
Z_2 = UnitZ(Factor=merge_2)
Z_3 = UnitZ(Factor=Slider(6, range=0..10))
move_2 = Move(Geometry=weave, Motion=Z_2)  # -> Geometry, Transform
join_2 = JoinCurves(Curves=pshift_3, Preserve=False)
loft = Loft(Curves=move_2.Geometry, Options={Adjust=False, Closed=False, LoftEnds=0, LoftSimp=0, LoftType=3, Rebuild=10, Refit=0.01})
move_3 = Move(Geometry=join_2, Motion=Z_3)  # -> simplify(Geometry), Transform
edges = BrepEdges(Brep=loft)  # -> Naked, Interior, NonManifold
merge_3 = Merge(Data1=item_4.Item, Data2=move_3.Geometry, Data3=item_4.Item1)
join_3 = JoinCurves(Curves=edges.Naked, Preserve=False)
loft_opt = LoftOptions(Closed=False, Adjust=False, Rebuild=0, Refit=0, Type=Slider(3, range=0..10))
project = Project(Geometry=join_3, Plane=PlaneXY(0, 0, 0))  # -> Geometry, Transform
loft_2 = Loft(Curves=merge_3, Options=loft_opt)
merge_4 = Merge(Data1=simplify(join_3), Data2=simplify(project.Geometry))
join_4 = BrepJoin(Breps=[boundary, loft_2, extr])  # -> Breps, Closed
panel_3 = Panel(loft_2)
loft_3 = Loft(Curves=merge_4, Options={Adjust=False, Closed=False, LoftEnds=0, LoftSimp=0, LoftType=3, Rebuild=10, Refit=0.01})
cap = CapHoles(Brep=join_4.Breps)
join_5 = BrepJoin(Breps=flatten([loft, loft_3]))  # -> Breps, Closed
cap_2 = CapHoles(Brep=join_5.Breps)
fmerge = MergeFaces(Brep=cap_2)  # -> Breps, Before, After
