# Grasshopper definition 17_line to surface.gh (Grasshopper 1.0.7)
# plug-ins: Anemone

crv = Curve([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])
crv_2 = Curve([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])
crv_3 = Curve([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])
# 3 Level - 09
boundary = BoundarySurfaces(Edges=crv)
crv_4 = Curve([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])
boundary_2 = BoundarySurfaces(Edges=crv_2)
midpt = CurveMiddle(Curve=crv_3)
midpt_2 = CurveMiddle(Curve=crv_4)
boundary_3 = BoundarySurfaces(Edges=crv_3)
debrep = DeconstructBrep(Brep=boundary_2)  # -> Faces, Edges, Vertices
planar = IsPlanar(Surface=boundary, Interior=True)  # -> Planar, Plane
hull = ConvexHull(Points=midpt, Plane=PlaneXY(0, 0, 0))  # -> Hull, HullZ, Indices
pdecon = Deconstruct(Point=midpt_2)  # -> XComponent, YComponent, ZComponent
explode = Explode(Curve=boundary_3, Recursive=True)  # -> Segments, Vertices
area = Area(Geometry=boundary)  # -> Area, Centroid
sort = SortList(Keys=pdecon.YComponent, ValuesA=crv_4)  # -> Keys, ValuesA
deplane = DeconstructPlane(Plane=planar.Plane)  # -> Origin, XAxis, YAxis, ZAxis
disc = Discontinuity(Curve=hull.Hull, Level=1)  # -> Points, Parameters
c_script = CSharpScript(pts=debrep.Vertices, id=Slider(11, range=0..100), line=crv_2, d=Slider(2.8, range=0..10))  # -> out, A; inputs pts: list of Point3d, id: Int32, line: list of Curve, d: Double
# ---------- c_script: C# usings ----------
using System.Linq;
using Rhino.UI;
# ---------- c_script: C# ----------
    List<List<Curve>> ans = new List<List<Curve>>();
    List<bool> vis = Enumerable.Repeat(false, line.Count + 1).ToList();
    var convex = ConvexHull2D(pts);
    convex.Add(convex[0]);
    var interPolate = Curve.CreateInterpolatedCurve(convex, 1);
    var purePts = PureDiscontinuity(interPolate);
    var pureCrv = Curve.CreateInterpolatedCurve(purePts, 1).DuplicateSegments().ToList();
    pureCrv = pureCrv.Where(x => x.GetLength() > 5.0).ToList();
    List<Curve> crv = new List<Curve> { pureCrv[id % pureCrv.Count] };
    
    for (int i = 0; i < 100; i++)
    {
      if (crv.Count == 0) break;
      var reference = Curve.JoinCurves(crv)[0];
      List<Curve> nxtCrv = new List<Curve>();
      for (int j = 0; j < line.Count; j++)
      {
        if (vis[j]) continue;
        double t;
        var now = CurveCenter(line[j]);
        reference.ClosestPoint(now, out t);
        var nxt = reference.PointAt(t);
        if (nxt.DistanceTo(now) < d)
        {
          vis[j] = true;
          nxtCrv.Add(line[j]);
        }
      }

      crv = nxtCrv; 
      ans.Add(nxtCrv);
    }
    A = MakeDataTree2D(ans);
# ---------- c_script: C# additional code ----------
  
  
public Point3d CurveCenter(Curve c)
{
  var arr = c.DivideByCount(2, true);
  var ans = c.PointAt(arr[1]);
  return ans;
}

public List<Point3d> PureDiscontinuity(Curve x)
{
  var seg = x.DuplicateSegments();
  List<Point3d> pts = new List<Point3d>();
  for (int i = 0; i < seg.Length - 1; i++)
  {
    var nowC = seg[i];
    var nxtC = seg[i + 1];
    var nowV = nowC.PointAtEnd - nowC.PointAtStart;
    var nxtV = nxtC.PointAtEnd - nxtC.PointAtStart;
    nowV.Unitize();
    nxtV.Unitize();
    double dp = Math.Abs(Vector3d.Multiply(nowV, nxtV));
    if (i == 0)
    {
      var prevC = seg[seg.Length - 1];
      var prevV = prevC.PointAtEnd - prevC.PointAtStart;
      prevV.Unitize();
      if (Math.Abs(Vector3d.Multiply(prevV, nowV)) < 0.99) pts.Add(nowC.PointAtStart);
    }

    if (dp < 0.99)
    {
      pts.Add(nowC.PointAtEnd);
    }
  }

  if (!x.IsClosed) pts.Add(seg[seg.Length - 1].PointAtEnd);
  return pts;
}

public List<Point3d> ConvexHull2D(List < Point3d > pts)
{
  if (pts.Count <= 1)
  {
    return pts;
  }

  pts.Sort((a, b) => a.X == b.X ? a.Y.CompareTo(b.Y) : a.X.CompareTo(b.X));

  List<Point3d> hull = new List<Point3d>(pts.Count + 1);
  int s = 0, t = 0;
  // Build lower hull
  foreach (var p in pts)
  {
    while (t >= s + 2 && CrossProduct(hull[t - 2], hull[t - 1], p) <= 0)
      t--;
    if (hull.Count > t)
      hull[t] = p;
    else
      hull.Add(p);
    t++;
  }

  s = --t;
  pts.Reverse();
  // Build upper hull
  foreach (var p in pts)
  {
    while (t >= s + 2 && CrossProduct(hull[t - 2], hull[t - 1], p) <= 0)
      t--;
    if (hull.Count > t)
      hull[t] = p;
    else
      hull.Add(p);
    t++;
  }

  return hull.GetRange(0, t - 1 - (t == 2 && hull[0].Equals(hull[1]) ? 1 : 0));
}

    // Function to compute the cross product of vectors (b - a) and (c - a)
private double CrossProduct(Point3d a, Point3d b, Point3d c)
{
  return (b.X - a.X) * (c.Y - a.Y) - (b.Y - a.Y) * (c.X - a.X);
}

public static DataTree<T> MakeDataTree2D<T>(List<List<T>> ret)
{
  DataTree<T> tree = new DataTree<T>();
  for (int i = 0; i < ret.Count; i++)
  {
    GH_Path path = new GH_Path(i);
    for (int j = 0; j < ret[i].Count; j++)
    {

      tree.Add(ret[i][j], path);
    }
  }

  return tree;
}
# ---------- end c_script ----------
hull_2 = ConvexHull(Points=explode.Vertices, Plane=PlaneXY(0, 0, 0))  # -> Hull, HullZ, Indices
item = ListItem(List=sort.ValuesA, Index=0, Wrap=True)
fline = FitLine(Points=explode.Vertices)
len = Length(Curve=boundary)  # -> expr("x / 4", Length)
ma = MassAddition(Input=[deplane.XAxis, deplane.YAxis])  # -> Result, PartialResults
pline = PolyLine(Vertices=disc.Points, Closed=False)
series = Series(Start=Slider(0, range=0..100), Step=Slider(90, range=0..100), Count=Slider(4, range=0..4))
simplify = SimplifyCurve(Curve=hull_2.Hull)  # -> Curve, Simplified
explode_2 = Explode(Curve=simplify.Curve, Recursive=True)  # -> Segments, Vertices
tstat = TreeStatistics(Tree=c_script.A)  # -> Paths, Length, Count
dprod = DotProduct(VectorA=sort.ValuesA, VectorB=item, Unitize=False)
colom = CollisionOneMany(Collider=explode_2.Segments, Obstacles=fline)  # -> Collision, Index
explode_3 = Explode(Curve=pline, Recursive=True)  # -> Segments, Vertices
explode_4 = Explode(Curve=simplify.Curve, Recursive=True)  # -> Segments, Vertices
amp = Amplitude(Vector=ma.Result, Amplitude=len)
cp = ControlPoints(Curve=simplify.Curve)  # -> Points, Weights, Knots
Z = UnitZ(Factor=1)
larger = LargerThan(FirstNumber=dprod, SecondNumber="0.5")  # -> LargerThan, OrEqualTo
dispatch = Dispatch(List=tstat.Paths, DispatchPattern=[True, False])  # -> ListA, ListB
midpt_3 = CurveMiddle(Curve=explode_3.Segments)
cull = CullPattern(List=explode_2.Segments, CullPattern=colom.Collision)
midpt_4 = CurveMiddle(Curve=explode_4.Segments)
dispatch_2 = Dispatch(List=sort.ValuesA, DispatchPattern=larger.LargerThan)  # -> ListA, ListB
crv_cp = CurveClosestPoint(Point=cp.Points, Curve=simplify.Curve)  # -> Point, Parameter, Distance
vrot = Rotate(Vector=amp, Axis=Z, Angle=degrees(series))
midpt_5 = CurveMiddle(Curve=cull)
pdecon_2 = Deconstruct(Point=midpt_3)  # -> XComponent, YComponent, ZComponent
branch = TreeBranch(Tree=c_script.A, Path=dispatch.ListA, MaintainPaths=True)
branch_2 = TreeBranch(Tree=c_script.A, Path=dispatch.ListB, MaintainPaths=True)
pdecon_3 = Deconstruct(Point=midpt_4)  # -> XComponent, YComponent, ZComponent
entwine = Entwine(Branch00=dispatch_2.ListA, Branch01=dispatch_2.ListB, FlattenInputs=True)
cull_i = CullIndex(List=crv_cp.Parameter, Indices="0", Wrap=True)
sort_2 = SortList(Keys=pdecon_2.YComponent, ValuesA=explode_3.Segments)  # -> Keys, reverse(ValuesA)
pdecon_4 = Deconstruct(Point=midpt_5)  # -> XComponent, YComponent, ZComponent
sort_3 = SortList(Keys=pdecon_3.YComponent, ValuesA=explode_4.Segments)  # -> Keys, reverse(ValuesA)
move = Move(Geometry=area.Centroid, Motion=vrot)  # -> Geometry, Transform
item_2 = ListItem(List=cull_i, Index=0, Wrap=True)
join = JoinCurves(Curves=entwine, Preserve=False)
sort_4 = SortList(Keys=pdecon_4.YComponent, ValuesA=cull)  # -> Keys, reverse(ValuesA)
item_3 = ListItem(List=sort_2.ValuesA, Index=0, Wrap=True)
item_4 = ListItem(List=sort_3.ValuesA, Index="1", Wrap=True)
item_5 = ListItem(List=move.Geometry, Index=Slider(4, range=0..4), Wrap=True)
midpt_6 = CurveMiddle(Curve=join)
seam = Seam(Curve=simplify.Curve, Seam=item_2)
item_6 = ListItem(List=sort_4.ValuesA, Index=0, Wrap=True)
pdecon_5 = Deconstruct(Point=midpt_6)  # -> XComponent, YComponent, ZComponent
end = EndPoints(Curve=seam)  # -> Start, End
simplify_2 = SimplifyCurve(Curve=seam)  # -> Curve, Simplified
midpt_7 = CurveMiddle(Curve=crv)  # -> graft(Midpoint)
sort_5 = SortList(Keys=pdecon_5.YComponent, ValuesA=join)  # -> Keys, ValuesA
explode_5 = Explode(Curve=simplify_2.Curve, Recursive=True)  # -> Segments, Vertices
loop_start = LoopStart(Repeat=Slider(10, range=0..10), Trigger=Toggle(False), Data=midpt_7)  # -> port, Counter, Data
ln = Line(StartPoint=midpt_7, EndPoint=item_5)
shift = ShiftList(List=sort_5.ValuesA, Shift=1, Wrap=invert(True))
lng = ListLength(List=explode_5.Segments)
len_2 = Length(Curve=explode_5.Segments)
panel = Panel("""0
1""")
colom_2 = CollisionOneMany(Collider=ln, Obstacles=crv)  # -> Collision, Index
short = ShortestList(ListA=sort_5.ValuesA, ListB=shift, TrimMode=2)  # -> ListA, ListB
sort_6 = SortList(Keys=len_2, ValuesA=explode_5.Segments)  # -> Keys, ValuesA
repeat = RepeatData(Data=graft(panel), Length=expr("x / 2", lng))  # -> flatten(Data)
tweencrv = TweenCurve(CurveA=graft(short.ListA), CurveB=graft(short.ListB), Factor=0.5, BlendType=0)  # -> flatten(Tween)
cull_2 = CullPattern(List=sort_6.ValuesA, CullPattern=repeat)
ext = ExtendCurve(Curve=tweencrv, Type=0, Start="-1", End="-1")
loop_end = LoopEnd(port=loop_start.port, Exit=False, TimeOutVal=0, pausedState=False, state="Constant output")
item_7 = ListItem(List=cull_2, Index=Slider(0, range=0..4), Wrap=True)  # -> flatten(Item)
mcx = MultipleCurves(Curves=ext)  # -> Points, IndexA, IndexB, ParamA, ParamB
midpt_8 = CurveMiddle(Curve=crv_3)
divide = DivideCurve(Curve=crv_3, Count="1", Kinks=False)  # -> flatten(Points), Tangents, Parameters
cps = ClosestPoints(Point=mcx.Points, Cloud=midpt_2, Count="4")  # -> ClosestPoint, CPIndex, Distance
cir = Circle(Plane=mcx.Points, Radius=1)
crv_cp_2 = CurveClosestPoint(Point=midpt_8, Curve=item_7)  # -> Point, Parameter, Distance
panel_2 = Panel("Collide")
alongcrv = SortAlongCurve(Points=cps.ClosestPoint, Curve=graft(cir))  # -> Points, Indices
sort_7 = SortList(Keys=crv_cp_2.Distance, ValuesA=crv_3)  # -> Keys, ValuesA
crv_cp_3 = CurveClosestPoint(Point=divide.Points, Curve=item_7)  # -> Point, Parameter, Distance
item_8 = ListItem(List=cps.CPIndex, Index=alongcrv.Indices, Wrap=True)
bool = Boolean(crv_cp_3.Distance)
item_9 = ListItem(List=crv_4, Index=item_8, Wrap=True)
cull_3 = CullPattern(List=crv_cp_3.Point, CullPattern=invert(bool))
lng_2 = ListLength(List=cull_3)
item_10 = ListItem(List=item_9, Index=0, Wrap=True)  # -> Item, Item1, Item2, Item3
partition = PartitionList(List=sort_7.ValuesA, Size=lng_2)
edgesrf = EdgeSurface(CurveA=item_10.Item, CurveB=item_10.Item1, CurveC=item_10.Item2, CurveD=item_10.Item3)  # -> flatten(Surface)
tstat_2 = TreeStatistics(Tree=partition)  # -> Paths, Length, Count
dispatch_3 = Dispatch(List=tstat_2.Paths, DispatchPattern=[True, False])  # -> ListA, ListB
branch_3 = TreeBranch(Tree=partition, Path=dispatch_3.ListA, MaintainPaths=True)
branch_4 = TreeBranch(Tree=partition, Path=dispatch_3.ListB, MaintainPaths=True)
join_2 = JoinCurves(Curves=branch_3, Preserve=False)
join_3 = JoinCurves(Curves=branch_4, Preserve=False)
